# Grasshopper definition BrepSendReceiveTest.ghx (Grasshopper 1.0.7)
# plug-ins: Speckle 2

# Doubleclick Me!
accounts = Accounts(
    {"Account (alan@rynne.es | https://iaac-speckle-server.herokuapp.com)": "f34a09a390d0c2d1da9fad2b51aee405", "Account (alan@speckle.systems | https://staging.speckle.dev)": "4f3b8d2197550b86f070c641aebd21a8"}, selected="Account (alan@speckle.systems | https://staging.speckle.dev)",
    selectedId="4f3b8d2197550b86f070c641aebd21a8",
    selectedServer="https://staging.speckle.dev")

number_slider = Slider(2.748, range=1.5..3)
number_slider_2 = Slider(1, range=0.8..1.4)
number_slider_3 = Slider(1.2, range=0.8..1.4)
number_slider_4 = Slider(5, range=0..10)
box = CenterBox(Base=PlaneXY(0, 0, 0), X=number_slider, Y=number_slider, Z=number_slider)
box_2 = CenterBox(Base=PlaneXY(0, 0, 0), X=number_slider_2, Y=number_slider_3, Z=number_slider_4)
box_3 = CenterBox(Base=PlaneXY(0, 0, 0), X=number_slider_4, Y=number_slider_2, Z=number_slider_3)
sdiff = SolidDifference(BrepsA=box, BrepsB=flatten(box_3))

division = Division(A=number_slider, B=2)
neg = Negative(Value=number_slider)
dom = ConstructDomain(DomainStart=neg, DomainEnd=number_slider)
range = Range(Domain=dom, Steps=10)
number_slider_5 = Slider(0.1, range=0..0.1)
pt = ConstructPoint(XCoordinate=graft(range), YCoordinate=range, ZCoordinate=neg)
multiplication = Multiplication(A=number_slider, B=3)
box_4 = DomainBox(Base=pt, X=number_slider_5, Y=number_slider_5, Z=multiplication)
id_1b72791e9e = CreateStream(Account=accounts, stream="1b72791e9e https://staging.speckle.dev 4f3b8d2197550b86f070c641aebd21a8")
cso = CreateSpeckleObject(A=sdiff)

send = Send(
    Data=cso,
    Stream=id_1b72791e9e,
    Branch="main",
    AutoSend=True,
    BaseId="30ac5f5390fdcc95696b0deabf9d0406",
    CurrentComponentState="up_to_date",
    KitName="Objects",
    OutputWrappers="https://staging.speckle.dev\t1b72791e9e\t54c3e55153",
    UseDefaultCache=False)
panel = Panel(send)
